# Grasshopper definition DRVaa.gh (Grasshopper 1.0.8)
# plug-ins: CORE.Toolbox.Grasshopper, Urbano2, Pufferfish, Urbano, Human, Heron, MetaHopper

panel = Panel("34.053051")  # disabled
panel_2 = Panel("-118.261245")  # disabled
panel_3 = Panel("-118.244401")  # disabled
panel_4 = Panel("34.044979")  # disabled
geographic_boundary = GeographicBoundary(Left=panel_2, Top=panel, Right=panel_3, Bottom=panel_4)  # -> Boundary, CoordinateReference; disabled
path = FilePath("C:\Users\l03063058\OneDrive - Instituto Tecnologico y de Estudios Superiores de Monterrey\TEC stuff\RESEARCH\10_experienceRouter\04_tool\01_DRVaa\Grasshopper\")  # disabled
panel_5 = Panel(geographic_boundary.Boundary)  # disabled
create_project_setting = CreateProjectSetting(
    Directory=path,
    Boundary=geographic_boundary.Boundary,
    Granularity="Block",
    DataLayers="osm",
    CoordinateReference=geographic_boundary.CoordinateReference)  # disabled
panel_6 = Panel(create_project_setting)  # disabled

# ---- group: INPUT
path_2 = FilePath("C:\Users\l03063058\Desktop\Github\DRVaa\Grasshopper\cityModels\SJO_match_large.osm")
panel_7 = Panel(path_2)

# ----
path_3 = FilePath(path_2)  # disabled
toggle = BooleanToggle(True)  # disabled
# URBANO 1
panel_8 = Panel(path_2)
project_setting = ProjectSetting(Json=create_project_setting, Run=toggle)  # disabled
importosm = ImportOSMFeatures(OSMPathOrURL=path_3, OSMFeatureType="building", Format="xml", ImportAltitude=False)  # -> Points, Metadata, UTMZone, TranslationVector; disabled
importosm_2 = ImportOSMFeatures(OSMPathOrURL=path_3, OSMFeatureType="amenity", Format="xml", ImportAltitude=False)  # -> Points, Metadata, UTMZone, TranslationVector; disabled
importosm_3 = ImportOSMFeatures(OSMPathOrURL=path_3, OSMFeatureType="street", Format="xml", ImportAltitude=False)  # -> Points, Metadata, UTMZone, TranslationVector; disabled

# ---- group: CSV file with perception data for each street segment (through LLM or participatory design)
path_4 = FilePath("C:\Users\l03063058\Desktop\Github\DRVaa\street_segments_scored_360_2.csv")

# ----
importosm_4 = ImportOSMFeatures(OSMPathOrURL=path_2, OSMFeatureType="building", Format="xml", ImportAltitude=False)  # -> Points, Metadata, UTMZone, TranslationVector
importosm_5 = ImportOSMFeatures(OSMPathOrURL=path_2, OSMFeatureType="street", Format="xml", ImportAltitude=False)  # -> Points, Metadata, UTMZone, TranslationVector
importosm_6 = ImportOSMFeatures(OSMPathOrURL=path_2, OSMFeatureType="amenity", Format="xml", ImportAltitude=False)  # -> Points, Metadata, UTMZone, TranslationVector
pline = PolyLine(Vertices=importosm_5.Points, Closed=False)
pline_2 = PolyLine(Vertices=importosm_4.Points, Closed=invert(False))
amen = CreateAmenity(PointLocationOfAmenity=importosm_6.Points, Metadata=importosm_6.Metadata)
streetnet = CreateStreetNetwork(
    StreetCurves=flatten(pline),
    Metadata=flatten(importosm_5.Metadata),
    SplitStreetCurves=True,
    UTMZone=importosm_5.UTMZone,
    TranslationVector=importosm_5.TranslationVector)  # -> StreetNetwork, StreetSegmentCurves, UTMZone, TranslationVector
bldg = CreateBuilding(BuildingCurve=pline_2, Metadata=importosm_4.Metadata, AmenitiesInBuilding=amen)
model = BuildUrbanoModel(Buildings=flatten(bldg), StreetNetwork=streetnet.StreetNetwork, BuildToggle=False)  # -> UrbanoModel, BuildingCurves, Activities
inbldg = InspectBuilding(Building=bldg, UrbanoModel=model.UrbanoModel, DefaultHeight=10)  # -> Geometry, Metadata, Amenity, flatten(BuildingMesh)

panel_9 = Panel(path_4)
pline_3 = PolyLine(Vertices=importosm.Points, Closed=invert(False))  # disabled
pline_4 = PolyLine(Vertices=importosm_3.Points, Closed=False)  # disabled
path_5 = FilePath("C:\Users\l03063058\Desktop\Github\DRVaa\SHPs\streets_scored_SJO_large\street_scored.shp")
bldg_2 = CreateBuilding(BuildingCurve=pline_3, Metadata=importosm.Metadata)  # disabled
streetnet_2 = CreateStreetNetwork(
    StreetCurves=flatten(pline_4),
    Metadata=flatten(importosm_3.Metadata),
    SplitStreetCurves=True,
    UTMZone=importosm_3.UTMZone,
    TranslationVector=importosm_3.TranslationVector)  # -> StreetNetwork, StreetSegmentCurves, UTMZone, TranslationVector; disabled
panel_10 = Panel(path_5)

# ---- group: CSV to SHP v003
py3 = Python3Script(csv_file=path_4, shp_file_path=path_5)  # -> GeoDataFrame, shp_file
#   port csv_file: CSV file with perception data (machine or human) for each street segment. File should include columns named latitude and longitude so it can georeference each street segment and convert to SHP file.
#   port shp_file_path: Select file path where SHP file will be saved.
# ---------- py3: Python ----------
#! python3
#r: pandas, geopandas

import pandas as pd
import geopandas as gpd
from shapely.geometry import Point

# Read CSV file
df = pd.read_csv(csv_file)


# Make sure CSV file has columns for latitud and longitud
# if 'latitude' not in df.columns or 'longitude' not in df.columns:
    # raise ValueError("CSV file must have 'latitude' and 'longitude' columns")
    

# Create point geometry based on coordinates
geometry = [Point(xy) for xy in zip(df['longitude'], df['latitude'])]
gdf = gpd.GeoDataFrame(df, geometry=geometry)

# Establish reference system (CRS), WGS84 for example
gdf.set_crs(epsg=4326, inplace=True)

# Display dataframe
GeoDataFrame = gdf

# Save as Shapefile
gdf.to_file(shp_file_path)

shp_file = shp_file_path

# print(GeoDataFrame.crs)
# ---------- end py3 ----------

# ----
panel_11 = Panel(importosm_4.Points)
model_2 = BuildUrbanoModel(Buildings=flatten(bldg_2), StreetNetwork=streetnet_2.StreetNetwork, BuildToggle=False)  # -> UrbanoModel, BuildingCurves, Activities; disabled
midpt = CurveMiddle(Curve=streetnet_2.StreetSegmentCurves)  # disabled
index = ItemIndex(List=streetnet_2.StreetSegmentCurves, Item=streetnet_2.StreetSegmentCurves)  # disabled
tag = TextTag(Location=midpt, Text=index)  # disabled
panel_12 = Panel(py3.GeoDataFrame)
crvtoscreen = RenderCurveToScreen(
    Curve=streetnet.StreetSegmentCurves,
    Location="100,700",
    ScaleFactor=Slider(0.1, range=0..1),
    Color=ColourSwatch(SwatchColor=RGB(255, 255, 255)),
    Thickness=1,
    Depth=".98",
    Fixed=True,
    m_scWithvp=False)
swatch = ColourSwatch(SwatchColor=RGBA(2, 124, 153, 177))
swatch_2 = ColourSwatch(SwatchColor=RGB(38, 137, 117))
swatch_3 = ColourSwatch(SwatchColor=RGB(98, 103, 104))
pt = Point(Point(985.9987441, 1851.366707, 0))
pt_2 = Point(Point(643.6389212, 2703.856789, 0))

# ---- group: SHP to GeoDataframe
py3_2 = Python3Script(SHP=py3.shp_file)  # -> GeoDataFrame
# ---------- py3_2: Python ----------
#! python3
#r: geopandas


#THIS IS NECESSARY TO LOAD PANDAS otherwise it bugs
import locale
locale.setlocale(locale.LC_ALL, 'en_US')

import geopandas as gpd

GeoDataFrame = gpd.read_file(SHP)
# ---------- end py3_2 ----------

# ----
argb = SplitARGB(Colour=swatch_3, IntegerChannels=True)  # -> Alpha, Red, Green, Blue

# ---- group: RESULTADOS / Huellas de edificios
crv = Curve(inbldg.Geometry)

# ---- group: RESULTADOS / Volumetrías
geo = Geometry(inbldg.BuildingMesh)

# ---- group: RESULTADOS / Red de calles
crv_2 = Curve(streetnet.StreetSegmentCurves)

# ---- group: Generate streets
swatch_4 = ColourSwatch(SwatchColor=RGB(0, 74, 117))
previewlw = CustomPreviewLineweights(Geometry=crv_2, Shader=swatch_3, Absolute=False)

# ---- group: destination
pt_3 = Point(Point(5034.232252, 2606.704757, 0))  # disabled

# ---- group: origin
pt_4 = Point(Point(2486.27064, 2269.662603, 0))  # disabled

# ---- group: Origin vs Destination
pt_5 = Point(pt_2)
pt_6 = Point(pt)
dot = AnnotationDot(Location=pt_5, PrimaryText="Origin", TextHeight=Slider(12, range=0..100))  # -> AnnotationDot, Location, PrimaryText, SecondaryText, TextHeight, Font
dots = DotDisplay(Point=[pt_5, pt_6], Colour=ColourSwatch(SwatchColor=RGB(2, 205, 153)), Size=Slider(14, range=0..100))
dot_2 = AnnotationDot(AnnotationDot=dot.AnnotationDot, Location=pt_6, PrimaryText="Destination")  # -> AnnotationDot, Location, PrimaryText, SecondaryText, TextHeight, Font

# ----
rgb = ColourRGB(Alpha="153", Red=argb.Red, Green=argb.Green, Blue=argb.Blue)

# ---- group: Generate buildings
swatch_5 = ColourSwatch(SwatchColor=RGBA(2, 124, 153, 177))
swatch_6 = ColourSwatch(SwatchColor=RGBA(100, 103, 102, 159))
preview = CustomPreview(Geometry=geo, Material=rgb)

# ----
splitstr = SplitStreetCurves(SplitStreetCurves=flatten(crv_2), IntersectionTolerance=1e-12)  # -> ProcessedStreetCurves, Metadata

# ---- group: Street names
lookup = LookupMetadata(MetadataGeometry=flatten(importosm_5.Metadata), SearchKey="name")
hframe = HorizontalFrame(Curve=reparameterize(splitstr.ProcessedStreetCurves), Parameter=Slider(0.5, range=0..1))
tag_2 = TextTag3D(
    Location=hframe,
    Text=lookup,
    Size=Slider(4, range=0..10),
    Colour=ColourSwatch(SwatchColor=RGB(0, 0, 0)),
    Justification=7)

# ---- group: Original Urbano router
router = Router(RouterUrbanoModelOrStreetNetwork=model_2.UrbanoModel, Origin=pt_4, Destination=pt_3, TravelMode="car", TimeLimit=-1)  # -> Trip, Route, Time, Distance; disabled
crv_3 = Curve(router.Route)  # disabled

# ---- group: New router gets more than one optimal route
number_slider = Slider(5, range=1..20)  # disabled
panel_13 = Panel("10.0")  # disabled
n_shortest_routes = Python3Script(Lines=streetnet_2.StreetSegmentCurves, StartPt=pt_4, EndPt=pt_3, Penalty=panel_13, K=number_slider)  # -> out, Routes, RouteIndices; inputs Lines: list of Curve, StartPt: Point3d, EndPt: Point3d, Penalty: Double, K: Int32; disabled
#   port Lines: Lines to convert to network.
#   port StartPt: Origin point.
#   port EndPt: Destination point.
#   port Penalty: Edge penalization to control how drastically the routes are forced to diverge. This, at the same time, forces the algorithm to give distinctive, alternative routes. A good starting point is 10.0
#   port Routes: Generated n routes.
#   port RouteIndices: Indices for line segments within routes.
# ---------- n_shortest_routes: Python ----------
#! python 3
# r: networkx

import rhinoscriptsyntax as rs
import Rhino.Geometry as rg
import networkx as nx

# NEW: Import Grasshopper's native Data Tree modules
import Grasshopper
from Grasshopper.Kernel.Data import GH_Path
import System

def get_distinct_paths_with_indices(curves, start_pt, end_pt, k, penalty_factor):
    if isinstance(curves, rg.Curve):
        curves = [curves]
        
    G = nx.Graph()
    
    def pt_to_key(pt):
        return (round(pt.X, 3), round(pt.Y, 3), round(pt.Z, 3))
        
    edge_geometries = {}
    edge_indices = {} 
    
    print("1. Building graph...")
    for original_idx, crv in enumerate(curves):
        if not crv: continue
        
        segments_to_process = []
        if crv.IsPolyline():
            success, polyline = crv.TryGetPolyline()
            if success:
                for seg in polyline.GetSegments():
                    segments_to_process.append(rg.LineCurve(seg))
        else:
            segments_to_process.append(crv)
            
        for seg_crv in segments_to_process:
            p1 = seg_crv.PointAtStart
            p2 = seg_crv.PointAtEnd
            
            k1 = pt_to_key(p1)
            k2 = pt_to_key(p2)
            
            length = seg_crv.GetLength()
            
            G.add_edge(k1, k2, weight=length)
            
            edge_geometries[(k1, k2)] = seg_crv
            edge_geometries[(k2, k1)] = seg_crv 
            edge_indices[(k1, k2)] = original_idx
            edge_indices[(k2, k1)] = original_idx
            
    if len(G.nodes) == 0:
        print("Error: No valid lines were provided.")
        return [], []

    def find_closest_node(graph, target_pt):
        closest_node = None
        min_dist = float('inf')
        for node in graph.nodes:
            node_pt = rg.Point3d(node[0], node[1], node[2])
            dist = target_pt.DistanceTo(node_pt)
            if dist < min_dist:
                min_dist = dist
                closest_node = node
        return closest_node

    start_key = find_closest_node(G, start_pt)
    end_key = find_closest_node(G, end_pt)
    
    k_paths_curves = []
    k_paths_indices = [] 
    
    print("2. Calculating distinctly penalized paths...")
    for i in range(k):
        try:
            path = nx.shortest_path(G, source=start_key, target=end_key, weight='weight')
            
            path_curves = []
            raw_path_indices = []
            
            for j in range(len(path) - 1):
                node_a = path[j]
                node_b = path[j+1]
                
                path_curves.append(edge_geometries[(node_a, node_b)])
                raw_path_indices.append(edge_indices[(node_a, node_b)])
                
                current_weight = G[node_a][node_b]['weight']
                G[node_a][node_b]['weight'] = current_weight * penalty_factor
                
            joined_curves = rg.Curve.JoinCurves(path_curves)
            if joined_curves:
                k_paths_curves.append(joined_curves[0])
                
                clean_indices = []
                for idx in raw_path_indices:
                    if not clean_indices or clean_indices[-1] != idx:
                        clean_indices.append(idx)
                
                k_paths_indices.append(clean_indices)
                
        except nx.NetworkXNoPath:
            print(f"Stopped early at {i} routes: No more valid alternative paths exist.")
            break
        except Exception as e:
            print("An error occurred: " + str(e))
            break
            
    print(f"Success: Found {len(k_paths_curves)} distinct routes.")
    
    # NEW: Convert the nested Python list into a strict Grasshopper Data Tree
    gh_tree = Grasshopper.DataTree[System.Object]()
    for branch_index, indices_list in enumerate(k_paths_indices):
        path = GH_Path(branch_index)
        for index_val in indices_list:
            gh_tree.Add(index_val, path)
            
    return k_paths_curves, gh_tree

if Lines and StartPt and EndPt and K and Penalty:
    Routes, RouteIndices = get_distinct_paths_with_indices(Lines, StartPt, EndPt, K, Penalty)
# ---------- end n_shortest_routes ----------
number_slider_2 = Slider(1, range=0..4)  # disabled
item = ListItem(List=n_shortest_routes.Routes, Index=number_slider_2, Wrap=invert(True))  # disabled
panel_14 = Panel(n_shortest_routes.RouteIndices)  # disabled

# ----
panel_15 = Panel(lookup)

# ---- group: Dataframe Details
py3_3 = Python3Script(dataFrame=py3_2)  # -> info, column_name, head_x10, tail_x10, shape, number_of_null_values
# ---------- py3_3: Python ----------
info = dataFrame.info

head_x10 = dataFrame.head(10)
tail_x10 = dataFrame.tail(10)
shape = dataFrame.shape

#Add up all null values
number_of_null_values = dataFrame.isnull().sum()



# columns = dataFrame.columns
# Get the columns as a list
column_name = dataFrame.columns.tolist()

# Output the list
# print(column_name)
# ---------- end py3_3 ----------

# ----
explode = Explode(Curve=splitstr.ProcessedStreetCurves, Recursive=True)  # -> flatten(Segments), Vertices
midpt_2 = CurveMiddle(Curve=explode.Segments)

# ---- group: select one branch
number_slider_3 = Slider(0, range=0..4)  # disabled
branch = BranchByIndex(Tree=n_shortest_routes.RouteIndices, Branch=number_slider_3)  # disabled
item_2 = ListItem(List=streetnet_2.StreetSegmentCurves, Index=branch, Wrap=True)  # disabled
midpt_3 = CurveMiddle(Curve=item_2)  # disabled
tag_3 = TextTag(Location=midpt_3, Text=branch)  # disabled

# ----
lng = ListLength(List=explode.Segments)
viewer = ParamViewer(n_shortest_routes.RouteIndices)  # disabled
xytodd = XYToDecimalDegrees(XyPoint=midpt_2)  # -> Latitude, Longitude, Transform
number_of_segments = Panel(lng)
point_to_lat_lon = Python3Script(Point=midpt_2)  # -> out, LAT, LON; inputs Point: Point3d
# ---------- point_to_lat_lon: Python ----------
import math
import Rhino

# 1. Fetch the origin coordinates from the Rhino Document's Earth Anchor Point
eap = Rhino.RhinoDoc.ActiveDoc.EarthAnchorPoint
lat_origin = eap.EarthBasepointLatitude
lon_origin = eap.EarthBasepointLongitude
print(lat_origin)


# Constants for Earth's geometry (in meters)
M_PER_DEG_LAT = 111111.0
M_PER_DEG_LON_EQ = 111320.0

# 2. Calculate the change in Latitude (using the Y coordinate in meters)
delta_lat = Point.Y / M_PER_DEG_LAT
LAT = lat_origin + delta_lat
print(delta_lat)

# 3. Calculate the change in Longitude (using the X coordinate in meters)
# We must convert the origin latitude to radians to use math.cos()
lat_rad = math.radians(lat_origin)
delta_lon = Point.X / (M_PER_DEG_LON_EQ * math.cos(lat_rad))
LON = lon_origin + delta_lon
print(LAT)
print(LON)
# ---------- end point_to_lat_lon ----------

# ---- group: select one branch
item_3 = ListItem(List=streetnet_2.StreetSegmentCurves, Index=n_shortest_routes.RouteIndices, Wrap=True)  # disabled
midpt_4 = CurveMiddle(Curve=item_3)  # disabled
tag_4 = TextTag(Location=midpt_4, Text=n_shortest_routes.RouteIndices)  # disabled

# ----
panel_16 = Panel(point_to_lat_lon.out)
panel_17 = Panel(point_to_lat_lon.LON)
panel_18 = Panel(point_to_lat_lon.LAT)

# ---- group: New router gets more than one optimal route / Sensations - options
myslider = Slider(4, range=0..5)

# ----
explode_2 = Explode(Curve=item, Recursive=True)  # -> Segments, Vertices; disabled
panel_19 = Panel(py3_3.column_name)
midpt_5 = CurveMiddle(Curve=explode_2.Segments)  # disabled
swatch_7 = ColourSwatch(SwatchColor=RGB(255, 0, 128))

perception_list = ValueList({"acoustic comfort": 6, "thermal comfort": 7, "somatic stress": 8, "social vitality": 9, "territorial safety": 10, "olfactory resonance": 11}, selected="somatic stress")
item_4 = ListItem(List=py3_3.column_name, Index=perception_list, Wrap=True)

complete_list = ValueList({"segment ID": 0, "latitude": 1, "longitude": 2, "street": 3, "image ID": 4, "image file": 5, "acoustic comfort": 6, "thermal comfort": 7, "somatic stress": 8, "social vitality": 9, "territorial safety": 10, "olfactory resonance": 11}, selected="acoustic comfort")
item_5 = ListItem(List=py3_3.column_name, Index=Slider(10, range=0..42), Wrap=True)

filter = StreamFilter(
    Gate=perception_list,
    Stream6="Acoustic comfort",
    Stream7="Thermal comfort",
    Stream8="Somatic stress",
    Stream9="Social vitality",
    Stream10="Territorial safety",
    Stream11="Olfactory resonance")
texttoscreen = RenderTextToScreen(
    Text=filter,
    Location="100,100",
    Size=Slider(32, range=0..100),
    Color=ColourSwatch(SwatchColor=RGB(255, 255, 255)),
    Font="consolas",
    m_scWithvp=False)

panel_20 = Panel("poppins")

# ---- group: attach to edges / insert street segments
crv_4 = Curve(streetnet.StreetSegmentCurves)

# ----
# Visualize streets by type (based on OSM tags)
panel_21 = Panel("highway")  # disabled
lookup_metadata = LookupMetadata(MetadataGeometry=crv_2, SearchKey=panel_21)  # disabled
button = Button()  # disabled
urbano_gradient = UrbanoGradient(
    Reverse=button,
    stops=[0: RGB(243, 57, 0), 0.1: RGB(236, 27, 60), 0.2: RGB(210, 0, 118), 0.3: RGB(103, 0, 120), 0.4: RGB(39, 72, 161), 0.5: RGB(1, 192, 229), 0.6: RGB(18, 178, 90), 0.7: RGB(79, 186, 8), 0.8: RGB(220, 237, 32), 0.9: RGB(247, 159, 20), 1: RGB(243, 57, 0)])  # disabled
panel_22 = Panel("OSM Street Tag")  # disabled
panel_23 = Panel("0.5 to 5")  # disabled
map_settings = MapSettings(Gradient=urbano_gradient, Legend=False, LegendTitle=panel_22, Label=False, LinewidthRange=panel_23)  # disabled
draw_map = DrawMap(Geometries=crv_2, Values=lookup_metadata, MapSettings=map_settings)  # disabled

# ----
# Visualize building by type (based on OSM tags)
panel_24 = Panel("building")  # disabled
lookup_metadata_2 = LookupMetadata(MetadataGeometry=geo, SearchKey=panel_24)  # disabled
button_2 = Button()  # disabled
urbano_gradient_2 = UrbanoGradient(
    Reverse=button_2,
    stops=[0: RGB(243, 57, 0), 0.1: RGB(247, 159, 20), 0.2: RGB(220, 237, 32), 0.3: RGB(79, 186, 8), 0.4: RGB(18, 178, 90), 0.5: RGB(1, 192, 229), 0.6: RGB(39, 72, 161), 0.7: RGB(103, 0, 120), 0.8: RGB(210, 0, 118), 0.9: RGB(236, 27, 60), 1: RGB(243, 57, 0)])  # disabled
panel_25 = Panel("OSM Building Tag")  # disabled
map_settings_2 = MapSettings(Gradient=urbano_gradient_2, Legend=True, LegendTitle=panel_25, Label=False)  # disabled
draw_map_2 = DrawMap(Geometries=geo, Values=lookup_metadata_2, MapSettings=map_settings_2)  # disabled

# ---- group: attach to edges / distance threshold
number_slider_4 = Slider(5, range=0..100)

# ----
# Perception (9s)
bounding_box = Relay()
toggle_2 = GroupToggle(ToggleActive=True, ToggleVisible=False)  # disabled

# ----
# LLM Walkability Perception
panel_26 = Panel(py3_3.head_x10)
importshp = ImportShapefileFeatures(
    ShapefilePath=py3.shp_file,
    Reproject=False,
    UTMZone=streetnet.UTMZone,
    TranslationVector=streetnet.TranslationVector,
    CroppingGeometry=bounding_box)  # -> simplify(flatten(Points)), Metadata, UTMZone, TranslationVector
demeta = DeconstructMetadata(Metadata=importshp.Metadata)  # -> Keys, Values
panel_28 = Panel(demeta.Values)
panel_29 = Panel(demeta.Keys)

panel_30 = Panel(importshp.Points)

# ----
# FILTERING
lookup_2 = LookupMetadata(MetadataGeometry=importshp.Metadata, SearchKey=item_4)
pt_7 = Point(flatten(importshp.Points))

lookup_3 = LookupMetadata(MetadataGeometry=importshp.Metadata, SearchKey=item_5)
bnd = Bounds(Numbers=lookup_2)
dedomain = DeconstructDomain(Domain=bnd)  # -> Start, End
panel_31 = Panel(dedomain.Start)
panel_32 = Panel(dedomain.End)

dots_2 = DotDisplay(Point=pt_7, Colour=ColourSwatch(SwatchColor=RGB(238, 95, 131)), Size=Slider(5, range=0..20))
dup_pts = CleanDuplicatePoints(Points=pt_7, Tolerance=0.01)  # -> Points, Indices, Status
dispatch = Dispatch(List=lookup_2, DispatchPattern=dup_pts.Status)  # -> ListA, ListB
panel_33 = Panel(dispatch.ListA)

points = PointList(Points=pt_7, Size=Slider(6, range=0..10))

# ---- group: raw
tag_5 = TextTag(Location=pt_7, Text=lookup_2)

# ---- group: eliminated duplicates
tag_6 = TextTag(Location=flatten(dup_pts.Points), Text=dispatch.ListA, Colour=ColourSwatch(SwatchColor=RGB(0, 0, 0)))

# ---- group: attach to edges / Insert points
pt_8 = Point(dup_pts.Points)

# ----
num = Number(dispatch.ListA)

# ---- group: Geometric route
swatch_8 = ColourSwatch(SwatchColor=RGB(0, 255, 0))

# ---- group: New router gets more than one optimal route
number_slider_5 = Slider(20, range=1..20)
n_shortest_routes_2 = Python3Script(Lines=splitstr.ProcessedStreetCurves, StartPt=pt_5, EndPt=pt_6, Penalty="10.0", K=Slider(30, range=1..50))  # -> out, Routes, RouteIndices; inputs Lines: list of Curve, StartPt: Point3d, EndPt: Point3d, Penalty: Double, K: Int32; same code as n_shortest_routes

# ---- group: Geometric route (continued)
branch_2 = BranchByIndex(Tree=n_shortest_routes_2.RouteIndices, Branch=Slider(0, range=0..10))
item_6 = ListItem(List=n_shortest_routes_2.Routes, Index=0, Wrap=True)
item_7 = ListItem(List=crv_2, Index=branch_2, Wrap=True)
len = Length(Curve=item_6)
path_distance = Panel(len)
previewlw_2 = CustomPreviewLineweights(Geometry=item_7, Shader=swatch_8, Thickness=Slider(3, range=0..10), Absolute=False)

# ----
lng_2 = ListLength(List=n_shortest_routes_2.Routes)
index_2 = ItemIndex(List=n_shortest_routes_2.Routes, Item=n_shortest_routes_2.Routes)
gradient = Gradient(
    LowerLimit=0,
    UpperLimit=lng_2,
    Parameter=index_2,
    stops=[0: RGB(243, 57, 0), 0.1: RGB(236, 27, 60), 0.2: RGB(210, 0, 118), 0.3: RGB(103, 0, 120), 0.4: RGB(39, 72, 161), 0.5: RGB(1, 192, 229), 0.6: RGB(18, 178, 90), 0.7: RGB(79, 186, 8), 0.8: RGB(220, 237, 32), 0.9: RGB(247, 159, 20), 1: RGB(243, 57, 0)])
int = Integer(path_distance)
len_2 = Length(Curve=n_shortest_routes_2.Routes)
panel_34 = Panel(n_shortest_routes_2.RouteIndices)
concat = Concatenate(FragmentA="Geometric path: ", FragmentB=int, FragmentC="m")
viewer_2 = ParamViewer(n_shortest_routes_2.RouteIndices)
panel_35 = Panel(len_2)
texttoscreen_2 = RenderTextToScreen(Text=concat, Location="100,220", Size=12, Color=swatch_8, m_scWithvp=False)
panel_36 = Panel(gradient)
previewlw_3 = CustomPreviewLineweights(Geometry=n_shortest_routes_2.Routes, Shader=gradient, Thickness="7", Absolute=False)

# ---- group: Column Values 001
py3_4 = Python3Script(dataFrame=py3.GeoDataFrame, column_name="acoustic")  # -> columnValues
# ---------- py3_4: Python ----------
columnValues = dataFrame[column_name].tolist()
# ---------- end py3_4 ----------

# ----
viewer_3 = ParamViewer(py3_4)
panel_37 = Panel(py3_4)

# ---- group: Pulse curve
number_slider_6 = Slider(5, range=0..10)
dom = ConstructDomain(DomainStart=0, DomainEnd=Slider(50, range=0..100))
swatch_9 = ColourSwatch(SwatchColor=RGB(255, 255, 0))

# ---- group: Selected path division and cylinder
Z = UnitZ(Factor=1)
Z_2 = UnitZ(Factor=Slider(40, range=0..100))

# ---- group: Percentage
Z_3 = UnitZ(Factor=Slider(10, range=0..100))

# ---- group: attach to edges
midpt_6 = CurveMiddle(Curve=crv_4)
pull = PullPoint(Point=pt_8, Geometry=graft(midpt_6), ClosestOnly=True)  # -> ClosestPoint, Distance, Index
avr = Average(Input=num)
number_slider_7 = Slider(9, range=0..10)
panel_39 = Panel(avr)
smaller = SmallerThan(FirstNumber=pull.Distance, SecondNumber=number_slider_4)  # -> SmallerThan, OrEqualTo
dispatch_2 = Dispatch(List=pull.ClosestPoint, DispatchPattern=smaller.SmallerThan)  # -> ListA, ListB
dispatch_3 = Dispatch(List=dispatch.ListA, DispatchPattern=smaller.SmallerThan)  # -> ListA, ListB
pt_9 = Point(dispatch_2.ListA)
points_2 = PointList(Points=flatten(pt_9), Size=number_slider_7)
panel_40 = Panel(pt_9)

# ---- group: attach to edges / check index
points_3 = PointList(Points=flatten(midpt_6), Size=number_slider_7)

# ---- group: attach to edges / Output: reordered data
data = Data(dispatch_3.ListA)

# ---- group: attach to edges (continued)
item_8 = ListItem(List=data, Index=0, Wrap=True)
item_9 = ListItem(List=data, Index=0, Wrap=True)
panel_41 = Panel(item_8)
bnd_2 = Bounds(Numbers=flatten(item_8))
nullrep = ReplaceNulls(Items=item_8, Replacements="0")  # -> flatten(Items), Count
dedomain_2 = DeconstructDomain(Domain=bnd_2)  # -> Start, End
gradient_2 = Gradient(
    LowerLimit=Slider(100, range=0..100),
    UpperLimit=Slider(0, range=0..100),
    Parameter=nullrep.Items,
    stops=[0: RGB(27, 117, 166), 0.125: RGB(0, 163, 191), 0.25: RGB(0, 201, 188), 0.375: RGB(135, 237, 161), 0.5: RGB(224, 224, 45), 0.625: RGB(250, 208, 82), 0.75: RGB(250, 160, 50), 0.875: RGB(232, 111, 30), 1: RGB(191, 40, 23)])
panel_42 = Panel(nullrep.Items)
col = Colour(gradient_2)
panel_43 = Panel(col)
previewlw_4 = CustomPreviewLineweights(Geometry=crv_4, Shader=col, Thickness=Slider(3, range=0..10), Absolute=False)

# ---- group: Check individual segments
item_10 = ListItem(List=nullrep.Items, Index="126", Wrap=True)
item_11 = ListItem(List=crv_4, Index="126", Wrap=True)
panel_44 = Panel(item_11)
panel_45 = Panel(item_10)

# ---- group: attach to edges / matched & filtered
tag_7 = TextTag(Location=midpt_6, Text=flatten(nullrep.Items))

# ---- group: perception scores
viewer_4 = ParamViewer(n_shortest_routes_2.RouteIndices)
item_12 = ListItem(List=nullrep.Items, Index=n_shortest_routes_2.RouteIndices, Wrap=True)
num_2 = Number(item_12)
avr_2 = Average(Input=num_2)  # -> flatten(ArithmeticMean)
listdexs = ListIndices(List=avr_2)
sort = SortList(Keys=avr_2, ValuesA=listdexs)  # -> reverse(Keys), reverse(ValuesA)
equals = Equality(FirstNumber=sort.Keys, SecondNumber=perception_list)  # -> Equality, Inequality
panel_46 = Panel(equals.Equality)
item_13 = ListItem(List=sort.ValuesA, Index=0, Wrap=True)
panel_47 = Panel(sort.ValuesA)
panel_48 = Panel(avr_2)
branch_3 = BranchByIndex(Tree=item_12, Branch=item_13)
panel_49 = Panel(sort.Keys)
panel_50 = Panel(branch_3)

# ---- group: New router gets more than one optimal route (continued)
item_14 = ListItem(List=n_shortest_routes_2.Routes, Index=item_13, Wrap=invert(True))

# ----
previewlw_5 = CustomPreviewLineweights(Geometry=item_14, Shader=swatch_7, Thickness="7", Absolute=False)
len_3 = Length(Curve=item_14)

# ---- group: Selected path division and cylinder
explode_3 = Explode(Curve=item_14, Recursive=True)  # -> Segments, Vertices
midpt_7 = CurveMiddle(Curve=explode_3.Segments)
reduce = RandomReduce(List=midpt_7, Reduction=Slider(41, range=0..100), Seed=Slider(12, range=0..100))

# ----
path_distance_2 = Panel(len_3)

# ---- group: Selected path division and cylinder
divide = DivideCurve(Curve=item_14, Count=Slider(7, range=0..10), Kinks=False)  # -> Points, Tangents, Parameters

# ---- group: Color selected path and cylinder
item_15 = ListItem(List=gradient, Index=item_13, Wrap=True)
argb_2 = SplitARGB(Colour=item_15, IntegerChannels=True)  # -> Alpha, Red, Green, Blue
rgb_2 = ColourRGB(Alpha=Slider(124, range=0..255), Red=argb_2.Red, Green=argb_2.Green, Blue=argb_2.Blue)

# ----
int_2 = Integer(path_distance_2)

# ---- group: Pulse curve (continued)
branch_4 = BranchByIndex(Tree=n_shortest_routes_2.RouteIndices, Branch=item_13)
remap = RemapNumbers(Value=branch_3, Source="0 to 100", Target=dom)  # -> Mapped, Clipped
item_16 = ListItem(List=crv_4, Index=branch_4, Wrap=True)
Z_4 = UnitZ(Factor=remap.Mapped)
midpt_8 = CurveMiddle(Curve=item_16)
move = Move(Geometry=midpt_8, Motion=Z_4)  # -> Geometry, Transform
pline_5 = PolyLine(Vertices=move.Geometry, Closed=False)
previewlw_6 = CustomPreviewLineweights(Geometry=pline_5, Shader=swatch_9, Thickness=Slider(1, range=0..10), Absolute=False)

# ----
concat_2 = Concatenate(FragmentA="Sensorial path: ", FragmentB=int_2, FragmentC="m")

# ---- group: Selected path division and cylinder (continued)
line = LineSDL(Start=divide.Points, Direction=Z, Length=Slider(50, range=0..100))
end = EndPoints(Curve=line)  # -> Start, End
cir = Circle(Plane=end.End, Radius=Slider(70, range=0..100))
extr = Extrude(Base=cir, Direction=Z_2)
previewlw_7 = CustomPreviewLineweights(Geometry=line, Shader=item_15, Thickness="3", Absolute=False)
item_17 = ListItem(List=extr, Index=Slider(7, range=0..7), Wrap=True)
preview_2 = CustomPreview(Geometry=extr, Material=rgb_2)

# ----
crvtoscreen_2 = RenderCurveToScreen(
    Curve=item_14,
    Location="100,700",
    ScaleFactor=Slider(0.06, range=0..1),
    Color=swatch_7,
    Thickness=Slider(2, range=0..10),
    Depth="1",
    Fixed=True,
    m_scWithvp=False)
texttoscreen_3 = RenderTextToScreen(Text=concat_2, Location="100,170", Size=12, Color=swatch_7, m_scWithvp=False)

# ---- group: Percentage (continued)
move_2 = Move(Geometry=move.Geometry, Motion=Z_3)  # -> Geometry, Transform
dots_3 = DotDisplay(Point=move.Geometry, Colour=swatch_9, Size=Slider(3, range=0..10))
tag_8 = TextTag(Location=move_2.Geometry, Text=branch_3, Colour=swatch_9)
tag_9 = TextTag3D(Location=move.Geometry, Text=branch_3, Size=Slider(23, range=0..100), Colour=swatch_9, Justification=7)

# ---- group: Dot image sampling
number_slider_8 = Slider(100, range=0..100)  # disabled
number_slider_9 = Slider(200, range=1..200)  # disabled
srf = Surface(reparameterize(extr))  # disabled
panel_51 = Panel("10")  # disabled
division = Division(A=number_slider_9, B=panel_51)  # disabled
item_18 = ListItem(List=srf, Index=0, Wrap=True)  # disabled
sdivide = DivideSurface(Surface=srf, UCount=division, VCount=number_slider_9)  # -> Points, Normals, Parameters; disabled
pshift = ShiftPaths(Data=sdivide.Parameters, Offset=-1)  # disabled
pshift_2 = ShiftPaths(Data=sdivide.Points, Offset=-1)  # -> simplify(Data); disabled
bang = ExplodeTree(Data=pshift)  # -> Branch0, Branch1, Branch2, Branch3, Branch4, Branch5, Branch6, Branch7; disabled
image = ImageSampler(
    bang.Branch0,
    FilePath="C:\Users\l03063058\OneDrive - Instituto Tecnologico y de Estudios Superiores de Monterrey\TEC stuff\RESEARCH\10_experienceRouter\05_other docs\01_aviacion.PNG",
    Filter="Colour",
    Interpolate=False,
    Umax=1,
    Umin=0,
    Vmax=1,
    Vmin=0,
    Wrap=1)  # disabled
image_2 = ImageSampler(
    bang.Branch1,
    FilePath="C:\Users\l03063058\OneDrive - Instituto Tecnologico y de Estudios Superiores de Monterrey\TEC stuff\RESEARCH\10_experienceRouter\05_other docs\02.PNG",
    Filter="Colour",
    Interpolate=False,
    Umax=1,
    Umin=0,
    Vmax=1,
    Vmin=0,
    Wrap=1)  # disabled
image_3 = ImageSampler(
    bang.Branch5,
    FilePath="C:\Users\l03063058\OneDrive - Instituto Tecnologico y de Estudios Superiores de Monterrey\TEC stuff\RESEARCH\10_experienceRouter\05_other docs\06.PNG",
    Filter="Colour",
    Interpolate=False,
    Umax=1,
    Umin=0,
    Vmax=1,
    Vmin=0,
    Wrap=1)  # disabled
image_4 = ImageSampler(
    bang.Branch6,
    FilePath="C:\Users\l03063058\OneDrive - Instituto Tecnologico y de Estudios Superiores de Monterrey\TEC stuff\RESEARCH\10_experienceRouter\05_other docs\07.PNG",
    Filter="Colour",
    Interpolate=False,
    Umax=1,
    Umin=0,
    Vmax=1,
    Vmin=0,
    Wrap=1)  # disabled
image_5 = ImageSampler(
    bang.Branch2,
    FilePath="C:\Users\l03063058\OneDrive - Instituto Tecnologico y de Estudios Superiores de Monterrey\TEC stuff\RESEARCH\10_experienceRouter\05_other docs\03.PNG",
    Filter="Colour",
    Interpolate=False,
    Umax=1,
    Umin=0,
    Vmax=1,
    Vmin=0,
    Wrap=1)  # disabled
image_6 = ImageSampler(
    bang.Branch7,
    FilePath="C:\Users\l03063058\OneDrive - Instituto Tecnologico y de Estudios Superiores de Monterrey\TEC stuff\RESEARCH\10_experienceRouter\05_other docs\08.PNG",
    Filter="Colour",
    Interpolate=False,
    Umax=1,
    Umin=0,
    Vmax=1,
    Vmin=0,
    Wrap=1)  # disabled
image_7 = ImageSampler(
    bang.Branch4,
    FilePath="C:\Users\l03063058\OneDrive - Instituto Tecnologico y de Estudios Superiores de Monterrey\TEC stuff\RESEARCH\10_experienceRouter\05_other docs\05.PNG",
    Filter="Colour",
    Interpolate=False,
    Umax=1,
    Umin=0,
    Vmax=1,
    Vmin=0,
    Wrap=1)  # disabled
image_8 = ImageSampler(
    bang.Branch3,
    FilePath="C:\Users\l03063058\OneDrive - Instituto Tecnologico y de Estudios Superiores de Monterrey\TEC stuff\RESEARCH\10_experienceRouter\05_other docs\04.PNG",
    Filter="Colour",
    Interpolate=False,
    Umax=1,
    Umin=0,
    Vmax=1,
    Vmin=0,
    Wrap=1)  # disabled
entwine = Entwine(
    Branch00=image,
    Branch01=image_2,
    Branch02=image_5,
    Branch03=image_8,
    Branch04=image_7,
    Branch05=image_3,
    Branch06=image_4,
    Branch07=image_6,
    FlattenInputs=True)  # disabled
item_19 = ListItem(List=bang.Branch0, Index=0, Wrap=True)  # disabled
number_slider_10 = Slider(100, range=1..255)  # disabled
lng_3 = ListLength(List=bang.Branch0)  # disabled
argb_3 = SplitARGB(Colour=entwine, IntegerChannels=True)  # -> Alpha, Red, Green, Blue; disabled
panel_52 = Panel(lng_3)  # disabled
rgb_3 = ColourRGB(Alpha=number_slider_10, Red=argb_3.Red, Green=argb_3.Green, Blue=argb_3.Blue)  # -> simplify(Colour); disabled
toggle_3 = GroupToggle(ToggleActive=True, ToggleVisible=False)  # disabled
dots_4 = DotDisplay(Point=pshift_2, Colour=rgb_3, Size=1)  # disabled

# ----
int_3 = Integer(branch_3)
avr_3 = Average(Input=int_3)
int_4 = Integer(avr_3)
concat_3 = Concatenate(FragmentA="Average perception score: ", FragmentB=int_4)
texttoscreen_4 = RenderTextToScreen(Text=concat_3, Location="100,150", Size=12, Color=swatch_9, m_scWithvp=False)
